# Requirement set reqs (R2022a)

## 1 [#1] Master sart the system

## 2 [#2] Master provides physical address

## 3 [#3] Provide internal register

## 4 [#6] Control the bus conflict through the protocol

## 5 [#7] System being fast (Informational)

## 6 [#8] Scalability of slaves count

## 7 [#9] No readtime time overhead

## 8 [#4] Data sent by master on write

## 9 [#5] Data provide on slave on read